# Grasshopper definition main.gh (Grasshopper 1.0.8)
# plug-ins: RhinoCodePluginGH

# ---- group: 모듈 변경시 자동 업데이트
module_watcher = GhPythonScript(clear_cache=Button())  # -> out; inputs clear_cache: Boolean
# ---------- module_watcher: Python ----------
import os
import System
import clr
clr.AddReference('System.Core')
from System import Action, Func
import scriptcontext as sc
import time
import importlib
import sys

import Rhino
import scriptcontext as sc
from Grasshopper.Kernel import GH_FileWatcher
from Grasshopper.Kernel import GH_FileWatcherEvents


APP_NAME = 'fx'
ROOT_DIR = os.path.dirname(ghdoc.Path)
PATH_CONNECTOR = '/' if os.name == 'posix' else '\\'
APP_DIR = ROOT_DIR + PATH_CONNECTOR + APP_NAME

print('ROOT', ROOT_DIR)

def get_module_name(subdir, file_name):
    base_name = subdir.replace(ROOT_DIR + PATH_CONNECTOR, '').replace(PATH_CONNECTOR, '.')
    return base_name + '.' + file_name.replace('.py', '')

def reload_all():
    # import sys for windows
    import sys
    
    to_delete = list()
    for module in sys.modules:
        if module.startswith(APP_NAME):
            to_delete.append(module)
    for module in to_delete:
        del sys.modules[module]
        
    for subdir, dirs, files in os.walk(APP_DIR):
        for f in files:
            if not f.endswith('.py') or f == '__init__.py':
                continue
            module_name = get_module_name(subdir, f)
            print(module_name)
            # 중복 리로드 막기
            if module_name in sys.modules:
                continue
            try:
                reload(importlib.import_module(module_name))
            except:
                pass


def callback_func(sender, filename, change):
    reload_all()


def create_python_watcher(dir_name):
    print('create_python_watcher', dir_name)
    return GH_FileWatcher.CreateDirectoryWatcher.Overloads[System.String, System.String, GH_FileWatcherEvents, GH_FileWatcher.FileChanged](
        dir_name, '*.py', GH_FileWatcherEvents.All, callback_func)

class ModuleWatcher:

    def __init__(self):
        self.watcher_list = []
        self.collect_watcher_list()

    def collect_watcher_list(self):
        self.watcher_list.append(create_python_watcher(APP_DIR))
        for subdir, dirs, files in os.walk(APP_DIR):
            for d in dirs:
                dir_name = subdir + PATH_CONNECTOR + d
                self.watcher_list.append(create_python_watcher(dir_name))

    def dispose(self):
        for w in self.watcher_list:
            w.Dispose()

if clear_cache and 'module_watcher' in sc.sticky:
    print('dispose watcher')
    sc.sticky['module_watcher'].dispose()
    del sc.sticky['module_watcher']

if 'module_watcher' not in sc.sticky:
    sc.sticky['module_watcher'] = ModuleWatcher()
    print('module watcher is enabled')
# ---------- end module_watcher ----------
panel = Panel(module_watcher)

# ----
geo = Geometry([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])
builder = Python3Script(
    script={MarshGuids=True, MarshInputs=True, MarshOutputs=True, Text="cHJpbnQgKCJIRUxMTyIp", Title="builder.py", Uri="file:///C:/Users/bsh96/Documents/GitHub/urban__auto_mass/builder.py", Taxon="*.*.python"},
    block_regions=geo,
    set_back_dist=Slider(5, range=0..10),
    min_width=Slider(20, range=0..100),
    max_width=Slider(45, range=0..100),
    min_dist_between_buildings=Slider(9, range=0..10),
    floor_height="4.0",
    min_floor=Slider(5, range=0..10),
    max_floor=Slider(45, range=0..100),
    GFA="500000",
    reset=Button())  # -> out, rails, skeletons, buildings, building_breps
geo_2 = Geometry(builder.rails)
geo_3 = Geometry(builder.building_breps)
geo_4 = Geometry(builder.buildings)
panel_2 = Panel(builder.out)
